# Grasshopper definition test_all.ghx (Grasshopper 1.0.7)
# plug-ins: AutodeskPlatformServices

# ---- group: Connect First
ccie = ConstructConnectionInfoEnvVars(AppIdVariable="FORGE_CLIENT_ID", AppSecretVariable="FORGE_CLIENT_SECRET", AccountIdVariable="FORGE_ACCOUNT_ID")
C = Connect(ConnectionInfo=ccie)

# ----
qcg = QueryClassificationGroups()
qcc = QueryClassificationCategories()
qd = QueryDisciplines()
qs = QuerySpecs()
panel = Panel(qs)
panel_2 = Panel(qcc)
panel_3 = Panel(qcg)
panel_4 = Panel(qd)
