# Grasshopper definition test_connection_strings.ghx (Grasshopper 1.0.7)
# plug-ins: AutodeskPlatformServices

cci = ConstructConnectionInfo(
    AppId="eURMmzDMipCcJSpxT2g2AHCn3reWtQdD",
    AppSecret="aAxP1tCDLrRlRByw",
    AccountId="c23b5198-ae28-40a3-a8cc-c679903254c6",
    ListenerPort="8080")
C = Connect(ConnectionInfo=cci)
qpg = QueryGroups(ConnectionInfo=C)
panel = Panel(qpg)
