# Grasshopper definition test_getParams.ghx (Grasshopper 1.0.7)
# plug-ins: AutodeskPlatformServices

ccie = ConstructConnectionInfoEnvVars(AppIdVariable="FORGE_CLIENT_ID", AppSecretVariable="FORGE_CLIENT_SECRET", AccountIdVariable="FORGE_ACCOUNT_ID")
C = Connect(ConnectionInfo=ccie)
qpg = QueryGroups(ConnectionInfo=C)
qpc = QueryParameterCollections(Connection=C, ParametersGroup=qpg)

# ---- group: Open test_getSetParams.3dm
geo = Geometry([<brep referenced from the Rhino model> x3])

# ----
qp = QueryParameters(Collection=qpc, SearchTerm="Width")
gp = GetParam(Object=geo, Parameter=qp)  # -> Object, Parameter, Value
panel = Panel(gp.Value)
