# Grasshopper definition test_getUsedParams.ghx (Grasshopper 1.0.7)
# plug-ins: AutodeskPlatformServices

# ---- group: Connect First
ccie = ConstructConnectionInfoEnvVars(AppIdVariable="FORGE_CLIENT_ID", AppSecretVariable="FORGE_CLIENT_SECRET", AccountIdVariable="FORGE_ACCOUNT_ID")
C = Connect(ConnectionInfo=ccie)

# ---- group: Find Parameter in Document
qdp = QueryDocumentParameters(SearchTerm="Win_Sash")

# ---- group: Open test_getSetParams.3dm
geo = Geometry([<brep referenced from the Rhino model> x3])

# ----
dp = DeconstructParameter(Parameter=qdp)  # -> TypeId, Name, Description, ReadOnly, Spec, Groups, Categories, Hidden, Association
gp = GetParam(Object=geo, Parameter=qdp)  # -> Object, Parameter, Value
panel = Panel([dp.TypeId, dp.Name, dp.Description, dp.ReadOnly, dp.Spec])
ds = DeconstructSpec(Spec=dp.Spec)  # -> TypeId, Name, Discipline
panel_2 = Panel(gp.Value)
panel_3 = Panel([ds.TypeId, ds.Name])
dd = DeconstructDiscipline(Discipline=ds.Discipline)  # -> TypeId, Name
panel_4 = Panel([dd.TypeId, dd.Name])
