# Grasshopper definition test_queryParams.ghx (Grasshopper 1.0.7)
# plug-ins: AutodeskPlatformServices

ccie = ConstructConnectionInfoEnvVars(AppIdVariable="FORGE_CLIENT_ID", AppSecretVariable="FORGE_CLIENT_SECRET", AccountIdVariable="FORGE_ACCOUNT_ID")
C = Connect(ConnectionInfo=ccie)
qpg = QueryGroups(ConnectionInfo=C)
qpc = QueryParameterCollections(Connection=C, ParametersGroup=qpg)
qp = QueryParameters(Collection=qpc, SearchTerm="Width")
panel = Panel(qp)
dp = DeconstructParameter(Parameter=qp)  # -> TypeId, Name, Description, ReadOnly, Spec, Groups, Categories, Hidden, Association
ds = DeconstructSpec(Spec=dp.Spec)  # -> TypeId, Name, Discipline
panel_2 = Panel(dp.TypeId)
panel_3 = Panel(ds.TypeId)
