# Grasshopper definition test_setParams.ghx (Grasshopper 1.0.7)
# plug-ins: AutodeskPlatformServices

ccie = ConstructConnectionInfoEnvVars(AppIdVariable="FORGE_CLIENT_ID", AppSecretVariable="FORGE_CLIENT_SECRET", AccountIdVariable="FORGE_ACCOUNT_ID")
C = Connect(ConnectionInfo=ccie)
qpg = QueryGroups(ConnectionInfo=C)
qpc = QueryParameterCollections(Connection=C, ParametersGroup=qpg)
qp = QueryParameters(Collection=qpc, SearchTerm="Width")

# ---- group: 42 as Value for All Params
lng = ListLength(List=qp)
repeat = RepeatData(Data=Slider(42, range=0..100), Length=lng)

# ---- group: Open test_getSetParams.3dm
geo = Geometry([<brep referenced from the Rhino model> x3])

# ----
sp = SetParam(Object=geo, Parameter=qp, Value=repeat)  # -> Object, Parameter, Value
panel = Panel(sp.Value)
